# Grasshopper definition testing.gh (Grasshopper 1.0.8)

path = FilePath("/Users/devonperoutky/Development/projects/3d-photo/grasshopper_scripts/ply_to_rhino_script.py")
txt = Text("test")
int = Integer(16)
num = Number(2)
path_2 = FilePath("/Users/devonperoutky/Development/projects/3d-photo/assets/JAPAN_test.ply")
file = ReadFile(File=path, PerLineParse=False)
py3 = Python3Script(
    script=file,
    file_path=path_2,
    scale_factor=num,
    subdivision_level=int,
    sample_percentage=Slider(0.907, range=0..1),
    render_mode=txt)  # -> out, geometries, colors; inputs file_path: String; unedited script template
panel = Panel(file)
preview = CustomPreview(Geometry=py3.geometries, Material=py3.colors)
panel_2 = Panel(py3.out)
panel_3 = Panel(py3.colors)
